# Grasshopper definition japan_c.gh (Grasshopper 1.0.4)

座面高さ = Slider(4, range=4..5, expression="x*100")
背もたれ細材本数 = Slider(2, range=2..5, expression="x*2")
脚太さ_座面厚み = Slider(2, range=2..4, expression="x*10")
背もたれ上端高さ = Slider(6, range=4..6, expression="x*100")
背もたれ下端 = Slider(4, range=0..4, expression="x*0.2")
基本奥行 = Slider(3, range=2..3, expression="x*200")
基本幅 = Slider(5, range=2..5, expression="x*200")
rectangle = Rectangle(Plane=PlaneXY(0, 0, 0), XSize=基本幅, YSize=基本奥行, Radius=0)  # -> Rectangle, Length
division = Division(A=脚太さ_座面厚み, B=-2)
division_2 = Division(A=脚太さ_座面厚み, B=2)
debrep = DeconstructBrep(Brep=rectangle.Rectangle)  # -> Faces, Edges, Vertices
dom = ConstructDomain(DomainStart=division, DomainEnd=division_2)
rectangle_2 = Rectangle(Plane=PlaneXY(0, 0, 0), XSize=dom, YSize=dom, Radius=0)  # -> Rectangle, Length
line = LineSDL(Start=debrep.Vertices, Direction=Vector(0, 0, 1), Length=座面高さ)
Z = UnitZ(Factor=1)
multiplication = Multiplication(A=debrep.Vertices, B=-1)
srf = Surface(debrep.Faces)
Z_2 = UnitZ(Factor=座面高さ)
move = Move(Geometry=srf, Motion=Z_2)  # -> Geometry, Transform
offset = Offset(Curve=move.Geometry, Distance=脚太さ_座面厚み, Plane=PlaneXY(0, 0, 0), Corners=1)
extrude = ExtrudeLinear(Profile=rectangle_2.Rectangle, OrientationP=multiplication, Axis=line, OrientationA=Z)
Z_3 = UnitZ(Factor=脚太さ_座面厚み)
boundary = BoundarySurfaces(Edges=offset)
cap = CapHoles(Brep=extrude)
extr = Extrude(Base=boundary, Direction=Z_3)
debrep_2 = DeconstructBrep(Brep=cap)  # -> Faces, Edges, Vertices
item = ListItem(List=debrep_2.Faces, Index=5, Wrap=True)  # -> Item, Item1
srf_2 = Surface(item.Item1)
area = Area(Geometry=srf_2)  # -> Area, Centroid
bang = ExplodeTree(Data=area.Centroid)  # -> Branch0, Branch1, Branch2, Branch3
pt = Point([bang.Branch2, bang.Branch3])
Z_4 = UnitZ(Factor=背もたれ上端高さ)
move_2 = Move(Geometry=pt, Motion=Z_4)  # -> Geometry, Transform
Y = UnitY(Factor="100")
move_3 = Move(Geometry=move_2.Geometry, Motion=Y)  # -> Geometry, Transform
orient = Orient(Geometry=rectangle_2.Rectangle, Source=PlaneXY(0, 0, 0), Target=pt)  # -> Geometry, Transform
arc = ArcSED(Start=pt, End=move_3.Geometry, Direction=Vector(0, 0, 1))  # -> Arc, Plane, Radius
swp1 = Sweep1(Rail=arc.Arc, Sections=orient.Geometry, Miter=1)
debrep_3 = DeconstructBrep(Brep=swp1)  # -> Faces, Edges, Vertices
bang_2 = ExplodeTree(Data=debrep_3.Edges)  # -> _00200, _00300
item_2 = ListItem(List=bang_2._00200, Index=10, Wrap=True)
item_3 = ListItem(List=bang_2._00300, Index=11, Wrap=True)
crv = Curve(reparameterize([item_2, item_3]))
shatter = Shatter(Curve=crv, Parameters=背もたれ下端)
item_4 = ListItem(List=shatter, Index=0, Wrap=True)  # -> Item, Item1
crv_2 = Curve(item_4.Item)
crv_3 = Curve(item_4.Item1)
end = EndPoints(Curve=crv_2)  # -> Start, End
loft = Loft(Curves=flatten(crv_3), Options={Adjust=False, Closed=False, LoftEnds=0, LoftSimp=0, LoftType=0, Rebuild=10, Refit=0.01})
multiplication_2 = Multiplication(A=脚太さ_座面厚み, B=-1)
pt_2 = Point(simplify(end.Start))
offset_2 = Offset(Surface=loft, Distance=multiplication_2, Retrim=True)
bang_3 = ExplodeTree(Data=pt_2)  # -> Branch0, Branch1
loft_2 = Loft(
    Curves=[loft, offset_2],
    Options={Adjust=False, Closed=False, LoftEnds=0, LoftSimp=0, LoftType=0, Rebuild=10, Refit=0.01})
ln = Line(StartPoint=bang_3.Branch0, EndPoint=bang_3.Branch1)
divide = DivideCurve(Curve=ln, Count=背もたれ細材本数, Kinks=True)  # -> Points, Tangents, Parameters
lng = ListLength(List=divide.Points)
bang_4 = ExplodeTree(Data=simplify(crv_2))  # -> Branch0, Branch1
subtraction = Subtraction(A=lng, B=2)
dom_2 = ConstructDomain(DomainStart="1", DomainEnd=subtraction)
crv_4 = Curve(bang_4.Branch0)
subset = SubList(List=divide.Points, Domain=dom_2, Wrap=True)  # -> List, Index
end_2 = EndPoints(Curve=crv_4)  # -> Start, End
rec = Rectangle({Plane=PlaneXY(-5, -20, 0), Size=Domain2(u=0..10, v=0..20)})
orient_2 = Orient(Geometry=crv_4, Source=end_2.Start, Target=subset.List)  # -> graft(Geometry), Transform
orient_3 = Orient(Geometry=rec, Source=PlaneXY(0, 0, 0), Target=subset.List)  # -> graft(Geometry), Transform
swp1_2 = Sweep1(Rail=orient_2.Geometry, Sections=orient_3.Geometry, Miter=1)
join = BrepJoin(Breps=[loft, offset_2, loft_2])  # -> Breps, Closed
brep = Brep(swp1)
brep_2 = Brep(extrude)
brep_3 = Brep(extr)
brep_4 = Brep([brep, join.Breps, swp1_2, brep_2, brep_3])
